# Grasshopper definition axis_generator.gh (Grasshopper 1.0.7)
# plug-ins: Pufferfish

# separate viz from geo
# add axis support
# support holes
# add T-bot wheel
list = ValueList({"T-bot": 1, "H-bot": 2}, selected="H-bot")
crv = Curve(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)
brep = Brep(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)
crv_2 = Curve([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])
plywood_s_e_parallel = Panel("X")
plywood_s_e_perpendicular = Panel("Y")
# Beam deflection: Simply Supported Beam (Point Load F) at Center):
carrige_mass_g = Panel("Z")

# ---- group: Rack Generator
# curve tail
# Repeating Wave
beam_width_15_mm = Slider(35, range=0..100)
beam_thickness_mm = Slider(12, range=0..100)
rack_width_mm_1inch = Slider(15, range=0..100)
number_of_teeth = Slider(120, range=0..500)
start = Curve([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])
brec = BoundingRectangle(Geometry=start, Plane=PlaneXY(0, 0, 0), Axis=0, Slide=0, Union=True)  # -> Bounding, DimensionX, DimensionY
holes_count = Slider(40, range=0..100)
holes_step = Slider(20, range=0..100)
hole_d = Slider(3, range=0..8)
vec = VectorXYZ(XComponent=brec.DimensionX, YComponent=0, ZComponent=0)  # -> Vector, Length
pocket_r = Slider(3.1, range=0..10)
arrlinear = LinearArray(Geometry=start, Direction=vec.Vector, Count=number_of_teeth)  # -> Geometry, Transform
series = Series(Start=0, Step=holes_step, Count=expr("x/2", holes_count))
join = JoinCurves(Curves=flatten(arrlinear.Geometry), Preserve=False)
neg = Negative(Value=series)
start_2 = Curve(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)
curvepoint = PointOnCurve(join, parameter=0)
curvepoint_2 = PointOnCurve(start_2, parameter=1)
X = UnitX(Factor=[neg, series])
move2pt = MoveToPoint(Geometry=start_2, PointA=curvepoint_2, PointB=curvepoint)  # -> Moved, Vector, Transform
neg_2 = Negative(Value=rack_width_mm_1inch)
join_2 = JoinCurves(Curves=flatten([join, move2pt.Moved]), Preserve=False)
Y = UnitY(Factor=neg_2)
curvepoint_3 = PointOnCurve(join_2, parameter=0)
curvepoint_4 = PointOnCurve(join_2, parameter=1)
move = Move(Geometry=curvepoint_3, Motion=Y)  # -> Geometry, Transform
move_2 = Move(Geometry=curvepoint_4, Motion=Y)  # -> Geometry, Transform
ln = Line(StartPoint=curvepoint_3, EndPoint=move.Geometry)
ln_2 = Line(StartPoint=move.Geometry, EndPoint=move_2.Geometry)
len = Length(Curve=ln_2)
length_of_the_rack_mm = Panel(len)
pt = ConstructPoint(XCoordinate=length_of_the_rack_mm, YCoordinate=beam_width_15_mm, ZCoordinate=0)
ln_3 = Line(StartPoint=curvepoint_4, EndPoint=move_2.Geometry)
rec_2pt = Rectangle2Pt(Plane=PlaneXY(0, 0, 0), PointA=move_2.Geometry, PointB=pt, Radius=0)  # -> Rectangle, Length
rack_scaled_along_x = Slider(1.2, range=0..2)
rack_scaled_along_x_2 = Slider(0.92, range=0..1)
merge = Merge(Data1=ln, Data2=ln_2, Data3=ln_3, Data5=join_2)
area = Area(Geometry=rec_2pt.Rectangle)  # -> Area, Centroid
join_3 = JoinCurves(Curves=flatten(merge), Preserve=False)
area_2 = Area(Geometry=join_3)  # -> Area, Centroid
cir = Circle(Plane=area_2.Centroid, Radius=expr("x/2", hole_d))
move_3 = Move(Geometry=cir, Motion=X)  # -> Geometry, Transform
area_3 = Area(Geometry=move_3.Geometry)  # -> Area, Centroid
scale_nu = ScaleNU(Geometry=rec_2pt.Rectangle, Plane=area.Centroid, ScaleX=rack_scaled_along_x_2, ScaleY=rack_scaled_along_x, ScaleZ=1)  # -> Geometry, Transform
cir_2 = Circle(Plane=area_3.Centroid, Radius=pocket_r)
rint = RegionIntersection(CurvesA=join_3, CurvesB=scale_nu.Geometry)

# ---- group: Rack Generator / Axis Support Holes
explode = Explode(Curve=rec_2pt.Rectangle, Recursive=True)  # -> Segments, Vertices
item = ListItem(List=explode.Segments, Index=0, Wrap=True)
midpt = CurveMiddle(Curve=item)
crv_3 = Curve([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])
yz = YZPlane(Origin=midpt)
mirror = Mirror(Geometry=crv_3, Plane=yz)  # -> Geometry, Transform

# ----
join_4 = JoinCurves(Curves=flatten(rint), Preserve=False)

# ---- group: Rack Generator (continued)
group = Group(Objects=flatten([move_3.Geometry, join_4]))
export = Merge(Data1=group, Data2=rec_2pt.Rectangle, Data3=mirror.Geometry, Data4=cir_2)

# ----
dam = DataDam(DataA=move_3.Geometry, BufferDelay=10000000, BufferMode=0)
dam_2 = DataDam(DataA=join_4, BufferDelay=10000000, BufferMode=0)

# ---- group: Visualize Machine
Z = UnitZ(Factor=beam_thickness_mm)
acrylic_thickness = Slider(3, range=0..10)
extr = Extrude(Base=dam, Direction=expr("x*3", Z))
Z_2 = UnitZ(Factor=beam_thickness_mm)
extr_2 = Extrude(Base=rec_2pt.Rectangle, Direction=Z)
area_4 = Area(Geometry=move_3.Geometry)  # -> Area, Centroid
move_4 = Move(Geometry=dam_2, Motion=Z_2)  # -> Geometry, Transform
Z_3 = UnitZ(Factor=acrylic_thickness)
depth_of_the_holes = Slider(6, range=0..10)
cap = CapHoles(Brep=extr)
pdecon = Deconstruct(Point=area_4.Centroid)  # -> XComponent, YComponent, ZComponent
extr_3 = Extrude(Base=move_4.Geometry, Direction=Z_3)
pt_2 = ConstructPoint(XCoordinate=pdecon.XComponent, YCoordinate=pdecon.YComponent, ZCoordinate=expr("x-1", pdecon.ZComponent))
cap_2 = CapHoles(Brep=extr_3)
cyl = Cylinder(Base=pt_2, Radius=expr("x+1", hole_d), Length=expr("x+1", depth_of_the_holes))
cap_3 = CapHoles(Brep=extr_2)
cap_4 = CapHoles(Brep=cyl)
preview = CustomPreview(Geometry=cap_2, Material=ColourSwatch(SwatchColor=RGB(18, 79, 184)))
sunion = SolidUnion(Breps=graft([cap, cap_4]))
sdiff = SolidDifference(BrepsA=cap_3, BrepsB=flatten(sunion))
preview_2 = CustomPreview(Geometry=sdiff, Material=ColourSwatch(SwatchColor=RGB(153, 153, 153)))
