# Grasshopper definition curve_to_UGS.gh (Grasshopper 1.0.7)
# plug-ins: Pufferfish

number_slider = Slider(40, range=0..100)
crv = Curve([<curve referenced from the Rhino model> x4])
pt = Point(Point(76, 19, 0))
crv_2 = Curve(<curve referenced from the Rhino model>)
crv_3 = Curve(<curve referenced from the Rhino model>)
srf = Surface(<surface referenced from the Rhino model>)
crv_4 = Curve(<curve referenced from the Rhino model>)
divide = DivideCurve(Curve=crv_2, Count=number_slider, Kinks=False)  # -> Points, Tangents, Parameters
divide_2 = DivideCurve(Curve=crv_3, Count=number_slider, Kinks=False)  # -> Points, Tangents, Parameters
paramptonsrf = ParameterPointOnSurface(Surface=srf, ParameterU=Slider(0.7, range=0..1), ParameterV=Slider(0.4, range=0..1))  # -> Point, Normal
cp = ControlPoints(Curve=crv_4)  # -> Points, Weights, Knots

cp_2 = ControlPoints(Curve=crv)  # -> Points, Weights, Knots
explode = Explode(Curve=crv, Recursive=True)  # -> Segments, Vertices
len = Length(Curve=explode.Segments)
panel = Panel(cp_2.Points)
ins = InsertItems(List=len, Item="0", Indices="0", Wrap=True)  # -> flatten(List)
ma = MassAddition(Input=ins)  # -> Result, PartialResults
panel_2 = Panel(ma.PartialResults)
pdecon = Deconstruct(Point=flatten(panel))  # -> XComponent, YComponent, ZComponent
multiplication = Multiplication(A="20", B="60")
multiplication_2 = Multiplication(A=panel_2, B="100")
int = Integer(multiplication_2)
claycura_start = Panel("""M109 S20.000000
;Sliced at: Tue 15-12-2020 14:14:58
;Basic settings: Layer height: 2 Walls: 4 Fill: 0
;Print time: 3 hours 20 minutes
;Filament used: 18.308m 1783.0g
;Filament cost: 274.62
;M190 S70 ;Uncomment to add your own bed temperature line
;M109 S20 ;Uncomment to add your own temperature line
G21        ;metric values
G90        ;absolute positioning
M82        ;set extruder to absolute mode
M107       ;start with the fan off
G1 Z2 F9000 ;move the platform down 15mm
G92 E0                  ;zero the extruded length
G1 F200 E3              ;extrude 3mm of feed stock
G92 E0                  ;zero the extruded length again
G1 F9000
;Put printing message on LCD screen
M117 Printing...""")
claycura_end = Panel("""M107
G0 F9000 X179.552 Y103.364 Z286.250
;End GCode
M104 S0                     ;extruder heater off
M140 S0                     ;heated bed heater off (if you have it)
G91                                    ;relative positioning
G1 E-1 F300                            ;retract the filament a bit before lifting the nozzle, to release some of the pressure
G1 Z+0.5 E-5  ;move Z up a bit and retract filament even more
M84                         ;steppers off
G90                         ;absolute positioning
;CURA_PROFILE_STRING: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""")
division = Division(A=int, B="100")
concat = Concatenate(
    FragmentA="G1",
    FragmentB=" F",
    FragmentC=multiplication,
    FragmentD=" X",
    FragmentE=pdecon.XComponent,
    FragmentF=" Y",
    FragmentG=pdecon.YComponent,
    FragmentH=" Z",
    FragmentI=pdecon.ZComponent,
    FragmentJ=" E",
    FragmentK=division)
merge = Merge(Data1=claycura_start, Data2=concat, Data3=claycura_end)
panel_3 = Panel(merge)

item = ListItem(List=divide.Points, Index=expr("x-1", number_slider), Wrap=True)
python = GhPythonScript(points=divide.Points)  # -> out, gcode; inputs points: list of Point3d
# ---------- python: Python ----------
gcode = []

gcode.append("M3 S0")
gcode.append("F1200")

for pt in points:
    gcode.append("G1 X{0} Y{1}".format(pt.X, pt.Y))

gcode.append("M3 S500")
# ---------- end python ----------
python_2 = GhPythonScript(points=divide_2.Points)  # -> out, gcode; inputs points: list of Point3d
# ---------- python_2: Python ----------
gcode = []

gcode.append("G21")
gcode.append("G90")
gcode.append("M3 S500")
gcode.append("G0 X5.000 Y5.000")
gcode.append("M3 S0")
gcode.append("F1200")

for pt in points:
    gcode.append("G1 X{0} Y{1}".format(pt.X, pt.Y))

gcode.append("M3 S500")
gcode.append("G0 X0.000 Y0.000")
gcode.append("M2 ;program end")
# ---------- end python_2 ----------
iso = IsoCurve(Surface=srf, UVPoint=paramptonsrf.Point)  # -> UIsocurve, VIsocurve
item_2 = ListItem(List=divide_2.Points, Index=expr("x-1", number_slider), Wrap=True)
crv_5 = Curve(iso.VIsocurve)
crv_6 = Curve(iso.UIsocurve)
ln = Line(StartPoint=item_2, EndPoint=item)
panel_4 = Panel(python.gcode)
panel_5 = Panel(python_2.gcode)
panel_6 = Panel(division)
